% Simulink data dictionary parameters.sldd

Ixx = 0.0086
Iyy = 0.0086
a1 = -1
a2 = 0.004349302
a3 = 1
a4 = 0.004349302
a5 = 0
b1 = 26.16279
b2 = 26.16279
b3 = 13.0814
g = 9.81
kd_Z = 10
kf = 3.13e-5
ki_Z = 0
km = 9.0e-7
kp_Phi = 2.9996
kp_Theta = 3.0239
kp_Z = 30
l = 0.225
m = 0.4794
omega_max = 8482300
kp_Psi = 3.9
ki_Psi = 0
ki_Phi = 0.17
kd_Phi = 0.87
ki_Theta = 0.17
kd_Theta = 0.87
kd_X = 5.7
ki_X = 0
kp_X = 19.5
kp_Y = 19.5
kd_Y = 5.7
ki_Y = 0
kd_Psi = 2.57